# Grasshopper definition importPts.gh (Grasshopper 1.0.7)
# plug-ins: LunchBox

path = FilePath("C:\Users\demin\github\STARThack\foo.csv")
path_2 = FilePath("C:\Users\demin\github\STARThack\foo.csv")
file = ReadFile(File=path_2, PerLineParse=True)
csv = ReadCSV(CSVString=file, Delimiter=";")  # -> Headers, Values
split = TextSplit(Text=csv.Values, Separators=",")
item = ListItem(List=split, Index=3, Wrap=True)  # -> Item, Item1, Item2
pt = ConstructPoint(XCoordinate=item.Item, YCoordinate=item.Item1, ZCoordinate=item.Item2)  # -> flatten(Point)
sort = SortList(Keys=flatten(item.Item), ValuesA=pt)  # -> Keys, ValuesA
python = GhPythonScript(x=item.Item, y=item.Item1)  # -> out, a
# ---------- python: Python ----------
__author__ = "demin"
__version__ = "2019.03.09"

import Rhino

a = Rhino.Geometry.Point2d(x,y)
# ---------- end python ----------
num = Number(item.Item2)
pline = PolyLine(Vertices=flatten(sort.ValuesA), Closed=False)
pt_2 = PointPolar(BasePlane=PlaneXY(0, 0, 0), XYAngle=python.a, ZAngle=num, Offset=1)
pt_3 = Point(pt_2)
dist = Distance(PointA=pt, PointB=pt_2)
